vi "Simple Resample.gvi"   [LabVIEW Communications System Design Suite 2.0.1]
# <Enter Description Here>
inputs:
  "input": f64[]
  "coerced IQ rate": f64
  "sample rate (S/s)": f64
outputs:
  "output": f64[]
uses:
  NI::Analysis::Resampling::Rational Resample (single channel, DBL).gvi
diagram:
  # Resample the data with the Rational Resample GVI.
  w1 = cluster{"interpolation": i32, "decimation": i32} {"interpolation"=1, "decimation"=1}
  Property Node(instance in=w1, "decimation"=$"coerced IQ rate", "interpolation"=$"sample rate (S/s)") -> (instance out=w2)
  call "Rational Resample (single channel, DBL).gvi"(signal=$input, resampling factor=w2) -> (resampled signal=w3)
  $output <- w3
