vi "Simple Sound.gvi"   [LabVIEW Communications System Design Suite 2.0.1]
inputs:
  "device ID": u32
  "error in": error
  "sound format": T1 = {"sample rate (S/s)"=44100, "number of channels"=1, "bits per sample"=16}
  "Action": enum{"Open", "Write", "Close"} = "Write"
  "data": waveform<f64> = {dt=1, Y=[]}
outputs:
  "sample rate (S/s)": f64
  "error out": error
  "task ID": "Sound Output Task ID.gtype"
types:
  T1 = cluster{"sample rate (S/s)": f64, "number of channels": i32, "bits per sample": i32}
  "Sound Output Task ID.gtype" = u32
diagram:
  Property Node(instance in=$"sound format") -> ("sample rate (S/s)"=w1)
  $"sample rate (S/s)" <- w1
  # Depending on the "Action" input, this VI will open a sound output session, write sound data, or close the sound output session.
  case ($Action) {
    frame "Open" {
      call "Sound Output Configure.gvi"(device ID=$"device ID", sound format=$"sound format", error in=$"error in") -> (task ID=w3, error out=w2)
    }
    frame "Write", Default {
      Property Node(instance in=$data) -> ("Y"=w4)
      Array Max And Min(array=w4) -> (max value=w5)
      Waveform Divide(error in=$"error in", x=$data, y=w5) -> (error out=w6, x/y=w7)
      Build Array(w7) -> w8
      call "Sound Output Write.gvi"(task ID in=$"device ID", data=w8, error in=w6) -> (task ID out=w3, error out=w2)
    }
    frame "Close" {
      call "Sound Output Clear.gvi"(task ID=$"device ID", error in=$"error in") -> (error out=w2)
      w3 = 0
    }
  }
  $"task ID" <- w3
  $"error out" <- w2
