vi "rx_demod_am_usrp2900.gvi"   [LabVIEW NXG 5.0.0]
panel controls:
  "RX - Carrier Frequency (f0) [Hz]": f64 = 130253500
  "RX - IQ Rate (fe) [Hz]": f64 = 80000
  "RX - Gain [dB]": f64 = 50
  "RX - Active Antenna": string = "RX2"
  "RX - Sampl. Num.": i64 = 5000
  "niUSRP Device": "niUSRPClass" = "NI2900"
  "stop": bool
  "averaging parameters": "Averaging Parameters.gtype" = {"averaging mode"="RMS averaging", "weighting mode"="Exponential", "number of averages"=6}  # averaging parameters defines how the averaging is computed. The specifications of the parameters include the type of averaging, the type of weighting, and the number of averages.
  "Fc, Low": f64 = 0.198979591837
  "Fc, High": f64 = 0.295918367347
  "Squelch Setup": f64 = 0.0004
panel indicators:
  "RX - Coerced Carrier Frequency (f0) [Hz]": f64
  "RX - Coerced IQ Rate (fe) [Hz]": f64
  "RX - Coerced Gain [dB]": f64
  "AM Demod (message)": f64[]
  "RX - Data - (Imaginary Part) - Baseband": f64[]
  "RX - Data - Spectrum (magnitude)": T1
  "Fc, Low_2": f64
  "Fc, High_2": f64
  "AM demod RMS Level": f64
  "AM Level (RMS)": f64
  "RMS Speech Level (Avg)": f64
  "Speech Level (Avg)": f64
types:
  T1 = cluster{"f0": f64, "df": f64, "magnitude": f64[]}
  T2 = enum{"No averaging", "Vector averaging", "RMS averaging", "Peak hold"}
  "Averaging Parameters.gtype" = cluster{"averaging mode": T2, "weighting mode": enum{"Linear", "Exponential"}, "number of averages": u32}
uses:
  NI::USRP::niUSRP Open Rx Session.gvi
  NI::USRP::niUSRP Configure Signal.gvi
  NI::USRP::niUSRP Initiate.gvi
  $::Simple Sound.gvi
  NI::USRP::niUSRP Fetch Rx Data (CDB).gvi
  NI::Analysis::Filtering::Chebyshev Bandpass Filter (CDB).gvi
  NI::Analysis::Filtering::Chebyshev Bandpass Filter (DBL).gvi
  NI::Analysis::Statistics::RMS (DBL).gvi
  $::Simple Resample.gvi
  NI::Analysis::Measurement::Power Spectral Density for 1 Chan.gvi
  NI::USRP::niUSRP Abort.gvi
  NI::USRP::niUSRP Close Session.gvi
  NI::G Core::Error::Display Error.gvi
diagram:
  call "niUSRP Open Rx Session.gvi"(device names=$"niUSRP Device") -> (session handle out=w1, R1=w2)
  call "niUSRP Configure Signal.gvi"(session handle=w1, IQ rate=w2, carrier frequency=$"RX - IQ Rate (fe) [Hz]", gain=$"RX - Carrier Frequency (f0) [Hz]", error in=$"RX - Gain [dB]", active antenna=$"RX - Active Antenna") -> (session handle out=w3, coerced IQ rate=w4, coerced carrier frequency=w5, coerced gain=w6, error out=w7)
  call "niUSRP Initiate.gvi"(session handle=w3, L1=w4) -> (session handle out=w8, R1=w9)
  Reciprocal(x=w5) -> w10
  call "Simple Sound.gvi"(Action="Open") -> (sample rate (S/s)=w11, error out=w12, task ID=w13)
  while {
    call "niUSRP Fetch Rx Data (CDB).gvi"(session handle=w8, number of samples=w9, timeout=$"RX - Sampl. Num.") -> (session handle out=w14, data=w15, R2=w16)
    call "Chebyshev Bandpass Filter (CDB).gvi"(signal=w16, high cutoff frequency=$"Fc, High", low cutoff frequency=$"Fc, Low", order=6) -> (filtered signal=w17)
    Absolute Value(x=w17) -> w18
    call "Chebyshev Bandpass Filter (DBL).gvi"(signal=w18, high cutoff frequency=0.0425, low cutoff frequency=0.00375, order=6) -> (filtered signal=w19)
    call "RMS (DBL).gvi"(x=w19) -> (rms value=w20)
    $"AM demod RMS Level" <- w20
    $"Fc, Low_2" <- $"Fc, Low"
    $"Fc, High_2" <- $"Fc, High"
    $"AM Level (RMS)" <- w20
    Complex To Real And Imaginary(x + iy=w16) -> w21
    $"RX - Data - (Imaginary Part) - Baseband" <- w21
    w22 = $"Squelch Setup"
    Type Cast() -> w23
    sequence (after w22) (after w19) (after w20) (after w23) {
      frame 0 {
        # The MathScript Node is not supported in LabVIEW NXG. Use the Interface for MATLAB® to call MATLAB functions or scripts. Visit ni.com/info and enter the Info Code ex8wq3 for information about migrating from MathScript Node to Interface for MATLAB.
        # The following is the original MathScript code (C:\Users\josh\Documents\LabVIEW Projects\ConvertedMathScript\MathScript_1.m):
        #
        # v_zero = zeros(length(v_data_in), 1).';
        #
        #
        # if d_rms_level > d_threshold
        #     v_data_out = v_data_in;
        # else
        #     v_data_out =v_zero;
        # end
        # error in
        # error out
        # d_rms_level
        # v_data_in
        # d_threshold
        Type Cast() -> w24
        # v_data_out
      }
    }
    call "Simple Resample.gvi"(input=f64[] [], coerced IQ rate=w5, sample rate (S/s)=w11) -> (output=w25)
    Build Waveform Node(Y=w25, dt=w10) -> (output waveform=w26)
    call "Simple Sound.gvi"(device ID=w13, error in=w12, Action="Write", data=w26) -> (error out=w27, task ID=w28)
    call "RMS (DBL).gvi"(x=f64[] []) -> (rms value=w29)
    Type Cast() -> w30
    Feedback Node(input=0) -> w31
    sequence (after w31) (after w29) (after w30) {
      frame 0 {
        # The MathScript Node is not supported in LabVIEW NXG. Use the Interface for MATLAB® to call MATLAB functions or scripts. Visit ni.com/info and enter the Info Code ex8wq3 for information about migrating from MathScript Node to Interface for MATLAB.
        # The following is the original MathScript code (C:\Users\josh\Documents\LabVIEW Projects\ConvertedMathScript\MathScript_2.m):
        #
        # % ** Smoothing Filter iterativ Form **
        #
        # C_FORGET_FACT = 0.2;
        #
        # d_sk_1 = d_sk;
        # d_sk = d_ek * C_FORGET_FACT + (1 - C_FORGET_FACT)*d_sk_1;
        # error in
        # error out
        # d_ek
        # d_sk
        Type Cast() -> w32
        # d_sk
      }
    }
    $"RMS Speech Level (Avg)" <- 0
    $"Speech Level (Avg)" <- 0
    call "Power Spectral Density for 1 Chan.gvi"(signal=w21, averaging parameters=$"averaging parameters", dB on=TRUE) -> (power spectral density=w33)
    $"RX - Data - Spectrum (magnitude)" <- w33
    $"AM Demod (message)" <- f64[] []
    Logical Or(w12, $stop) -> w34
    stop if w34
  }
  call "niUSRP Abort.gvi"(session handle=w14, L1=w15) -> (session handle out=w35, R1=w36)
  call "niUSRP Close Session.gvi"(session handle=w35, L1=w36) -> (R1=w37)
  call "Display Error.gvi"(error in=w37)
  call "Simple Sound.gvi"(device ID=w28, error in=w27, Action="Close")
  $"RX - Coerced Gain [dB]" <- w7
  $"RX - Coerced Carrier Frequency (f0) [Hz]" <- w6
  $"RX - Coerced IQ Rate (fe) [Hz]" <- w5
